# Grasshopper definition Neil_Weighted Voronoi.gh (Grasshopper 1.0.7)
# plug-ins: Weaverbird, Super Delaunay 2d

pt = Point([Point(9, 43, 0), Point(20, 52, 0), Point(22, 35, 0), Point(32, 39, 0), Point(26, 54, 0), Point(40, 61, 0), Point(46, 50, 0), Point(41.29719162, 52.0966301, 0.425249964)])  # disabled
lng = ListLength(List=pt)
vb = VBScript(genelist="Neil_Gene", count=lng)  # -> out, A; disabled
# ---------- vb: VB usings ----------
Imports System.IO
Imports System.Linq
Imports System.Data
Imports System.Drawing
Imports System.Reflection
Imports System.Windows.Forms
Imports System.Xml
Imports System.Xml.Linq
Imports Microsoft.VisualBasic
Imports System.Runtime.InteropServices

Imports Rhino.DocObjects
Imports Rhino.Collections
Imports GH_IO
Imports GH_IO.Serialization
# ---------- vb: VB ----------
    For Each obj As IGH_DocumentObject In owner.OnPingDocument().Objects
      If (obj.ComponentGuid <> New Guid("{21553c44-ea62-475e-a8bb-62b2a3ee5ca5}")) Then Continue For
      If (obj.NickName Like genelist) Then
        CallByName(obj, "Count", CallType.Set, count)
        'CallByName(obj, "ExpireSolution", CallType.Method, False)
        Return
      End If
    Next

    Print("No matching Gene list object found")
# ---------- end vb ----------
geo = Geometry(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)  # disabled
set_bounding_geometry = GetGeometry(AtLeast=1, AtMost=1, DeleteInput=False, Filter=1074004029)
define_6_points = GetPoint(AtLeast=6, AtMost=6, Prompt="Define 6 Points", Realtime=True)
neil_gene = GenePool(Decimals=2, Maximum=20, Minimum=0, Value=[9.22785317, 4.299615195, 2.092784672, 15.12509978, 14.10976967, 6.81345058])
set_radius = GetNumber(Slider(0.5, range=0..1), AtLeast=1, AtMost=1, Maximum=1, Minimum=0.1, Prompt="Set Radius")
set_division_factor = GetNumber(Slider(1.5, range=0..2), AtLeast=1, AtMost=1, Maximum=2, Minimum=0.1, Prompt="Set Division Factor")
set_different_weights = GetNumber(
    neil_gene,
    AtLeast=8,
    AtMost=8,
    Maximum=1.797693135e+308,
    Minimum=-1.797693135e+308,
    Prompt="Set Different Weights 0 to 20")  # disabled
delaunay = Delaunay(Points=define_6_points, Weights=neil_gene, Radius=set_radius, DivisionFactor=set_division_factor, DelaunayOutputMode=4)  # -> Delaunay, ThickenerPrimal, ThickenerPrimalTopology
list = ValueList({"One": 1, "Two": 2, "Three": 2² - 1, "Zero": 0}, selected="One")
delaunay_2 = Delaunay(
    PreexistingDelaunay=delaunay.Delaunay,
    Bounds=set_bounding_geometry,
    Radius=set_radius,
    DivisionFactor=set_division_factor,
    DelaunayInputMode=2,
    DelaunayOutputMode=5)  # -> Delaunay, ThickenerDual, ThickenerDualTopology
wbcatmullclark = WeaverbirdsCatmullClarkSubdivision(MeshCurves=delaunay_2.ThickenerDual, Level=list, SmoothNakedEdges=1)
mesh = Mesh(wbcatmullclark)
context_bake = ContextBake(Geometry=mesh)
